# Dynamo graph Auto Modeling.dyn (Dynamo 2.1.0.7500)

# group: Filter specific Model Elements
element_types = ElementTypes("ImportInstance")
all_elements_of_type = ElementsOfType(element_type=element_types)
code_block = CodeBlock { "Name"; }
getParameterValueByName = Element.GetParameterValueByName(element=all_elements_of_type, parameterName=code_block)
code_block_2 = CodeBlock { "Retain wall part 2 2105.dwg"; }
contains = String.Contains(str=getParameterValueByName, searchFor=code_block_2)
filterByBoolMask = List.FilterByBoolMask(list=all_elements_of_type, mask=contains)

watch = Watch(filterByBoolMask.in)

# group: Extracting the center point of blocks
geometry = Element.Geometry(element=watch)
boundingBox = Geometry.BoundingBox(geometry=geometry)
minPoint = BoundingBox.MinPoint(boundingBox=boundingBox)
X = Point.X(point=minPoint)
maxPoint = BoundingBox.MaxPoint(boundingBox=boundingBox)
X_2 = Point.X(point=maxPoint)
code_block_3 = CodeBlock(x1=X, x2=X_2) { (x1+x2)/2; }
sum = Math.Sum(values=code_block_3)
count = List.Count(list=code_block_3, lacing=CrossProduct)
code_block_4 = CodeBlock(a=sum, b=count) { a/b; }
Y = Point.Y(point=minPoint)
Y_2 = Point.Y(point=maxPoint)
code_block_5 = CodeBlock(y1=Y, y2=Y_2) { (y1+y2)/2; }
sum_2 = Math.Sum(values=code_block_5)
count_2 = List.Count(list=code_block_5, lacing=CrossProduct)
code_block_6 = CodeBlock(a=sum_2, b=count_2) { a/b; }

# group: Inputs
levels_start_level = Levels("Level 1")
structural_column_types = StructuralColumnTypes("UC305x305x97")

levels_end_level = Levels("Level 2")

# group: Column Elevation alignment
elevation = Level.Elevation(level=levels_start_level)
elevation_2 = Level.Elevation(level=levels_end_level)

# group: Modeling Columns
byCoordinates = Point.ByCoordinates(x=code_block_4, y=code_block_6, z=elevation)
byCoordinates_2 = Point.ByCoordinates(x=code_block_4, y=code_block_6, z=elevation_2)
byStartPointEndPoint = Line.ByStartPointEndPoint(startPoint=byCoordinates, endPoint=byCoordinates_2)
columnByCurve = StructuralFraming.ColumnByCurve(curve=byStartPointEndPoint, level=levels_start_level, structuralColumnType=structural_column_types)
